# Grasshopper definition masterscript.gh (Grasshopper 1.0.7)
# plug-ins: Hops, MetaHopper, Wombat, Human, LayoutTools, DevHopsGH

startupdata = StartupData()  # disabled
legend = Legend(
    Colour=[RGB(246, 220, 172), RGB(237, 176, 35), RGB(229, 115, 44), RGB(224, 59, 49), RGB(37, 159, 164)],
    Tags=["'todo'", "'inprogress'", "'changerequested'", "'review'", "'done'"],
    LegendType=1)

# ----
# Master Script
boolean_toggle = BooleanToggle(False)
getallworkitems = GetAllWorkItems()  # -> TasksIDs, TasksStatus
open_board = OpenBoard(OpenBoard=boolean_toggle)
panel = Panel(getallworkitems.TasksIDs)

# ---- group: Metahopper groups colouring
get_groups = GetGroups()  # -> Groups, GroupStyles, Nickname, Color
get_objects_in_group = GetObjectsInGroup(Group=get_groups.Groups)
object_info = ObjectInfo(Objects=get_objects_in_group)  # -> Name, NickName, Type, Pivot, Bounds, Value, Enabled, Preview
text = Text(object_info.Name)
c_script = CSharpScript(x=text, y="Panel")  # -> out, A; inputs x: String, y: String
# ---------- c_script: C# ----------
    if (x == y)
    {
      A = true;
    } else
    {
      A = false;
    }
# ---------- end c_script ----------
dispatch = Dispatch(List=get_objects_in_group, DispatchPattern=c_script.A)  # -> ListA, ListB
c_script_2 = CSharpScript(x=dispatch.ListA)  # -> out, A
# ---------- c_script_2: C# ----------
    if (x != null)
    {
      Grasshopper.Kernel.Special.GH_Panel panel = x as Grasshopper.Kernel.Special.GH_Panel;
      var text = panel.UserText;

      if (text.Length == 36)
      {
        A = panel.UserText;
      }
    }
# ---------- end c_script_2 ----------
clean_tree = CleanTree(RemoveNulls=True, RemoveInvalid=True, RemoveEmpty=False, Tree=c_script_2.A)
simplify_tree = SimplifyTree(Tree=clean_tree, Front=False)
c_script_3 = CSharpScript(x=simplify_tree)  # -> out, A; inputs x: list of String
# ---------- c_script_3: C# ----------
    var list = new List<int>();
    A = x.Count;
    for (int i = 0; i < x.Count ; i++)
    {
      if (x.Count > 1)
      {
        list.Add(i);
      }
    }
# ---------- end c_script_3 ----------
clean_tree_2 = CleanTree(RemoveNulls=True, RemoveInvalid=True, RemoveEmpty=False, Tree=simplify_tree)
dispatch_2 = Dispatch(List=graft(get_groups.Groups), DispatchPattern=c_script_3.A)  # -> ListA, ListB
panel_2 = Panel("""Todo
Inprogress
Review
ChangeRequested
Done""")
create_set = CreateSet(List=getallworkitems.TasksIDs)  # -> Set, Map
clean_tree_3 = CleanTree(RemoveNulls=True, RemoveInvalid=True, RemoveEmpty=False, Tree=dispatch_2.ListA)
create_set_2 = CreateSet(List=panel_2)  # -> Set, Map
member_index = MemberIndex(Set=create_set.Set, Member=clean_tree_2)  # -> Index, Count
merge = Merge(
    Data1=ColourSwatch(SwatchColor=RGB(245, 219, 171)),
    Data2=ColourSwatch(SwatchColor=RGB(237, 177, 36)),
    Data3=ColourSwatch(SwatchColor=RGB(224, 58, 49)),
    Data4=ColourSwatch(SwatchColor=RGB(230, 115, 44)),
    Data5=ColourSwatch(SwatchColor=RGB(38, 159, 163)))
list_item = ListItem(List=getallworkitems.TasksStatus, Index=member_index.Index, Wrap=True)
list_item_2 = ListItem(List=clean_tree_3, Index=member_index.Index, Wrap=True)
member_index_2 = MemberIndex(Set=create_set_2.Set, Member=list_item)  # -> Index, Count
list_item_3 = ListItem(List=merge, Index=member_index_2.Index, Wrap=True)
set_group_properties = SetGroupProperties(Group=list_item_2, NickName=list_item, Color=list_item_3)

# ---- group: Inprogress
number_slider = Slider(180, range=0..1000)
relpath = RelativePath(Path="tasks\Massing.gh")
hops = Hops(
    _Path=relpath,
    TaskID="d41f4132-5d79-11ed-9b6a-0242ac120002",
    Radius=Slider(60, range=0..100),
    Height=Slider(300, range=0..1000),
    TwistAngle=180,
    CacheResultsInMemory=True,
    CacheSolveResults=True,
    RemoteDefinitionLocation="C:\Users\jszychowska\source\DevHops\DevHopsGhSamples\tasks\Massing.gh",
    RemoteSolveVersion=(0, 1, 0),
    ShowInput_Enabled=False,
    ShowInput_Path=True,
    SynchronousSolve=True)

# ----
panel_3 = Panel("""        'todo': '#F6DCAC'
        'inprogress': '#EDB023'
        'changerequested': '#E5732C'
        'review': '#E03B31'
        'done': '#259FA4'""")
trim = TextTrim(Text=panel_3, Start=True, End=True)
split = TextSplit(Text=trim, Separators=":")
item = ListItem(List=split, Index=0, Wrap=True)  # -> Item, Item1
rep = ReplaceText(Text=item.Item1, Find="'", Replace=" ", RecursiveReplace=False)
trim_2 = TextTrim(Text=rep, Start=True, End=True)
panel_4 = Panel(trim_2)
col = Colour(flatten(panel_4))

# ---- group: ChangeRequested
panel_5 = Panel("df63e25a-5d79-11ed-9b6a-0242ac120002")
relpath_2 = RelativePath(Path="tasks\Panelization_2.0.gh")
hops_2 = Hops(
    _Path=relpath_2,
    TaskID=panel_5,
    IntFaceCountUPerSrf=Slider(4, range=0..10),
    BrepMass=hops,
    CacheResultsInMemory=False,
    CacheSolveResults=False,
    RemoteDefinitionLocation="C:\Users\jszychowska\source\DevHops\DevHopsGhSamples\tasks\Panelization_2.0.gh",
    RemoteSolveVersion=(0, 1, 0),
    ShowInput_Enabled=False,
    ShowInput_Path=True,
    SynchronousSolve=True)

# ----
preview = CustomPreview(Geometry=hops, Material=graft(ColourSwatch(SwatchColor=RGB(38, 141, 146))))  # disabled

updatestatuscomponent = UpdateStatusComponent(
    TaskID=panel_5,
    Status="ChangesRequested",
    Screenshot=Toggle(False),
    AddComment="Please update data structure and indicate colour scheme.")  # disabled

# ---- group: Done
relpath_3 = RelativePath(Path="tasks\SubStructures.gh")
hops_3 = Hops(
    _Path=relpath_3,
    TaskID="f739958c-5d79-11ed-9b6a-0242ac120002",
    SrfPanelsByScope=hops_2,
    NumPipeRadius=Slider(0.4, range=0..1),
    BrepMass=hops,
    CacheResultsInMemory=True,
    CacheSolveResults=True,
    RemoteDefinitionLocation="C:\Users\jszychowska\source\DevHops\DevHopsGhSamples\tasks\SubStructures.gh",
    RemoteSolveVersion=(0, 1, 0),
    ShowInput_Enabled=False,
    ShowInput_Path=True,
    SynchronousSolve=True)  # -> CrvMullionPipes, BrepMullionPipes

# ---- group: ChangeRequested
panel_6 = Panel("df63e25a-5d79-11ed-9b6a-0242ac120002")
data = Data(hops)
data_2 = Data(hops_2)

relpath_4 = RelativePath(Path="tasks\PanelRationalize.gh")
hops_4 = Hops(
    _Path=relpath_4,
    TaskID="f7399577-5d79-22ed-9b6a-0242ac990a02",
    SrfPanelsByScope=hops_2,
    CacheResultsInMemory=True,
    CacheSolveResults=True,
    RemoteDefinitionLocation="C:\Users\jszychowska\source\DevHops\DevHopsGhSamples\tasks\PanelRationalize.gh",
    RemoteSolveVersion=(0, 1, 0),
    ShowInput_Enabled=False,
    ShowInput_Path=True,
    SynchronousSolve=True)

# ---- group: Done
relpath_5 = RelativePath(Path="tasks\Patterning.gh")
hops_5 = Hops(
    _Path=relpath_5,
    TaskID="ea4952b8-5d79-11ed-9b6a-0242ac120002",
    SrfPanelsByScope=hops_2,
    CacheResultsInMemory=True,
    CacheSolveResults=True,
    RemoteDefinitionLocation="C:\Users\jszychowska\source\DevHops\DevHopsGhSamples\tasks\Patterning.gh",
    RemoteSolveVersion=(0, 1, 0),
    ShowInput_Enabled=False,
    ShowInput_Path=True,
    SynchronousSolve=True)

# ---- group: Review
panel_7 = Panel("f7399577-5d79-22ed-9b6a-0242ac120a02")
data_3 = Data(hops)
data_4 = Data(hops_2)

# ----
G = Data(hops_3.BrepMullionPipes)
tstat = TreeStatistics(Tree=simplify(G))  # -> Paths, Length, Count; disabled
crv = Curve(G)
dpath = DeconstructPath(Branch=tstat.Paths)  # disabled
evalsrf = EvaluateSurface(Surface=reparameterize(G), Point=Point(0.5, 0.5, 0))  # -> Point, Normal, UDirection, VDirection, Frame
tstat_2 = TreeStatistics(Tree=simplify(G))  # -> Paths, Length, Count
join = TextJoin(Text=dpath)  # disabled
points = PointList(Points=evalsrf.Point)
bnd = Bounds(Numbers=flatten(join))  # disabled
randcol = RandomColor(Data=tstat_2.Paths, Seed=2, FastMode=False)
remap = RemapNumbers(Value=join, Source=bnd, Target=Domain(0, 1))  # -> Mapped, Clipped; disabled
gradient = Gradient(
    LowerLimit=0,
    UpperLimit=1,
    Parameter=remap.Mapped,
    stops=[0: RGB(243, 57, 0), 0.1: RGB(236, 27, 60), 0.2: RGB(210, 0, 118), 0.3: RGB(103, 0, 120), 0.4: RGB(39, 72, 161), 0.5: RGB(1, 192, 229), 0.6: RGB(18, 178, 90), 0.7: RGB(79, 186, 8), 0.8: RGB(220, 237, 32), 0.9: RGB(247, 159, 20)])  # disabled
preview_2 = CustomPreview(Geometry=G, Material=graft(randcol))
previewlw = CustomPreviewLineweights(Geometry=crv, Shader=ColourSwatch(SwatchColor=RGB(0, 0, 0)), Thickness=Slider(1, range=0..1), Absolute=False)  # disabled

# ---- group: Todo
panel_8 = Panel("ea4952b8-5d79-11ed-9b6a-024bac120002")
data_5 = Data(hops_3.BrepMullionPipes)
data_6 = Data(hops_4)

panel_9 = Panel("f739958c-5d79-11ed-9b6a-0242ac120a02")
data_7 = Data(hops_3.CrvMullionPipes)
# Extract Data for Estimation
# inputs:
# Pipe Curves
# Panels
# Pattern elements: number of perforation? Surface area of paint?
# outputs:
# data stats
# Visualization
# Texture maps
data_8 = Data(hops_4)

# ----
iteratename = Button()
bake_image = Button()
bake_text = Button()
open_image_text_folder = Button()
open_test_image_folder = Button()
pystep = PythonStepper(Up=iteratename)  # -> C
# ---------- pystep: Python ----------
initVal = 0
step = 1
reset = R
up = Up
down = Dn

if not 'acc' in vars():
    acc = initVal

if reset > 0:
    acc = initVal

if up > 0:
    acc += step
if down > 0:
    acc -= step

C = acc
# ---------- end pystep ----------
format = Format(Format="{0}{1:00}{2}", Culture=127, Data0="C:\Users\jkamm\Dropbox\devhops\images\tempView", Data1=pystep, Data2=".jpg")
saveview = SaveViewportToFile(Run=bake_image, ViewportName="ScriptView", Render=False, FilePath=format, ScaleFactor=Slider(0.5, range=0..1))
img2str = SerializeImageToString(ImagePath=saveview)

panel_10 = Panel(format)

len = TextLength(Text=saveview)
subtraction = Subtraction(A=len, B="3")
fragment = TextFragment(Text=saveview, Start="0", Count=subtraction)
concat = Concatenate(FragmentA=fragment, FragmentB="txt")

opensesame = SafeFolderOpener(Open=open_image_text_folder, Folders=concat)
file = ReadFile(File=concat, PerLineParse=True)
writetxt = WriteToTextFile(Run=bake_text, TextToWrite=img2str, FilePath=concat, Append=False, NewOnly=False)
str2img = DeserializeImageFromString(ImageString=file)
opensesame_2 = SafeFolderOpener(Open=open_test_image_folder, Folders=str2img)
