# Grasshopper definition masterscript_brandColors.gh (Grasshopper 1.0.7)
# plug-ins: Hops, MetaHopper, DevHopsGH, Wombat, Human, LayoutTools

startupdata = StartupData()  # disabled
legend = Legend(
    Colour=[RGB(246, 220, 172), RGB(237, 176, 35), RGB(229, 115, 44), RGB(224, 59, 49), RGB(37, 159, 164)],
    Tags=["'todo'", "'inprogress'", "'changerequested'", "'review'", "'done'"],
    LegendType=1)

# ----
# Master Script
boolean_toggle = BooleanToggle(False)
getallworkitems = GetAllWorkItems()  # -> TasksIDs, TasksStatus
open_board = OpenBoard(OpenBoard=boolean_toggle)
panel = Panel(getallworkitems.TasksIDs)

# ---- group: Metahopper groups colouring
get_groups = GetGroups()  # -> Groups, GroupStyles, Nickname, Color
get_objects_in_group = GetObjectsInGroup(Group=get_groups.Groups)
object_info = ObjectInfo(Objects=get_objects_in_group)  # -> Name, NickName, Type, Pivot, Bounds, Value, Enabled, Preview
text = Text(object_info.Name)
c_script = CSharpScript(x=text, y="Panel")  # -> out, A; inputs x: String, y: String
# ---------- c_script: C# ----------
    if (x == y)
    {
      A = true;
    } else
    {
      A = false;
    }
# ---------- end c_script ----------
dispatch = Dispatch(List=get_objects_in_group, DispatchPattern=c_script.A)  # -> ListA, ListB
c_script_2 = CSharpScript(x=dispatch.ListA)  # -> out, A
# ---------- c_script_2: C# ----------
    if (x != null)
    {
      Grasshopper.Kernel.Special.GH_Panel panel = x as Grasshopper.Kernel.Special.GH_Panel;
      var text = panel.UserText;

      if (text.Length == 36)
      {
        A = panel.UserText;
      }
    }
# ---------- end c_script_2 ----------
clean_tree = CleanTree(RemoveNulls=True, RemoveInvalid=True, RemoveEmpty=False, Tree=c_script_2.A)
simplify_tree = SimplifyTree(Tree=clean_tree, Front=False)
c_script_3 = CSharpScript(x=simplify_tree)  # -> out, A; inputs x: list of String
# ---------- c_script_3: C# ----------
    var list = new List<int>();
    A = x.Count;
    for (int i = 0; i < x.Count ; i++)
    {
      if (x.Count > 1)
      {
        list.Add(i);
      }
    }
# ---------- end c_script_3 ----------
clean_tree_2 = CleanTree(RemoveNulls=True, RemoveInvalid=True, RemoveEmpty=False, Tree=simplify_tree)
dispatch_2 = Dispatch(List=graft(get_groups.Groups), DispatchPattern=c_script_3.A)  # -> ListA, ListB
panel_2 = Panel("""Todo
Inprogress
Review
ChangeRequested
Done""")
create_set = CreateSet(List=getallworkitems.TasksIDs)  # -> Set, Map
clean_tree_3 = CleanTree(RemoveNulls=True, RemoveInvalid=True, RemoveEmpty=False, Tree=dispatch_2.ListA)
create_set_2 = CreateSet(List=panel_2)  # -> Set, Map
member_index = MemberIndex(Set=create_set.Set, Member=clean_tree_2)  # -> Index, Count
merge = Merge(
    Data1=ColourSwatch(SwatchColor=RGB(245, 219, 171)),
    Data2=ColourSwatch(SwatchColor=RGB(237, 177, 36)),
    Data3=ColourSwatch(SwatchColor=RGB(224, 58, 49)),
    Data4=ColourSwatch(SwatchColor=RGB(230, 115, 44)),
    Data5=ColourSwatch(SwatchColor=RGB(38, 159, 163)))
list_item = ListItem(List=getallworkitems.TasksStatus, Index=member_index.Index, Wrap=True)
list_item_2 = ListItem(List=clean_tree_3, Index=member_index.Index, Wrap=True)
member_index_2 = MemberIndex(Set=create_set_2.Set, Member=list_item)  # -> Index, Count
list_item_3 = ListItem(List=merge, Index=member_index_2.Index, Wrap=True)
set_group_properties = SetGroupProperties(Group=list_item_2, NickName=list_item, Color=list_item_3)

# ---- group: Inprogress
number_slider = Slider(180, range=0..1000)
relpath = RelativePath(Path="tasks\Massing_1.1.gh")
massing = Hops(
    _Path=relpath,
    TaskID="d41f4132-5d79-11ed-9b6a-0242ac120002",
    Radius=Slider(60, range=0..100),
    Height=Slider(300, range=0..1000),
    TwistAngle=180,
    CacheResultsInMemory=True,
    CacheSolveResults=True,
    RemoteDefinitionLocation="C:\Users\jkamm\git\DevHops\DevHopsGhSamples\tasks\Massing_1.1.gh",
    RemoteSolveVersion=(0, 1, 0),
    ShowInput_Enabled=False,
    ShowInput_Path=True,
    SynchronousSolve=True)

# ----
panel_3 = Panel("tasks\Panelization_2.0.gh")

# ---- group: ChangeRequested
panel_4 = Panel("df63e25a-5d79-11ed-9b6a-0242ac120002")
relpath_2 = RelativePath(Path="tasks\Panelization_1.0.gh")
panelization = Hops(
    _Path=relpath_2,
    TaskID=panel_4,
    IntFaceCountUPerSrf=Slider(5, range=0..10),
    BrepMass=massing,
    CacheResultsInMemory=False,
    CacheSolveResults=False,
    RemoteDefinitionLocation="C:\Users\jkamm\git\DevHops\DevHopsGhSamples\tasks\Panelization_1.0.gh",
    RemoteSolveVersion=(0, 1, 0),
    ShowInput_Enabled=False,
    ShowInput_Path=True,
    SynchronousSolve=True)

# ----
updatestatuscomponent = UpdateStatusComponent(
    TaskID=panel_4,
    Status="ChangesRequested",
    Screenshot=Toggle(False),
    AddComment="Please update data structure and indicate colour scheme.")  # disabled
viewer = ParamViewer(panelization)

# ---- group: Review
srf_panelsbyscope = Data(panelization)
brep_mass = Data(massing)
panel_5 = Panel("f7399577-5d79-22ed-9b6a-0242ac120a02")

# ---- group: Done
srf_panelsbyscope_2 = Data(panelization)
relpath_3 = RelativePath(Path="tasks\Patterning.gh")
patterning = Hops(
    _Path=relpath_3,
    TaskID="ea4952b8-5d79-11ed-9b6a-0242ac120002",
    SrfPanelsByScope=srf_panelsbyscope_2,
    CacheResultsInMemory=True,
    CacheSolveResults=True,
    RemoteDefinitionLocation="C:\Users\jkamm\git\DevHops\DevHopsGhSamples\tasks\Patterning.gh",
    RemoteSolveVersion=(0, 1, 0),
    ShowInput_Enabled=False,
    ShowInput_Path=True,
    SynchronousSolve=True)

srf_panelsbyscope_3 = Data(panelization)
brep_mass_2 = Data(massing)
relpath_4 = RelativePath(Path="tasks\SubStructures.gh")
substructure = Hops(
    _Path=relpath_4,
    TaskID="f739958c-5d79-11ed-9b6a-0242ac120002",
    SrfPanelsByScope=srf_panelsbyscope_3,
    NumPipeRadius=Slider(0.4, range=0..1),
    BrepMass=brep_mass_2,
    CacheResultsInMemory=True,
    CacheSolveResults=True,
    RemoteDefinitionLocation="C:\Users\jkamm\git\DevHops\DevHopsGhSamples\tasks\SubStructures.gh",
    RemoteSolveVersion=(0, 1, 0),
    ShowInput_Enabled=False,
    ShowInput_Path=True,
    SynchronousSolve=True)  # -> CrvMullionPipes, BrepMullionPipes

# ---- group: ChangeRequested
srf_panelsbyscope_4 = Data(panelization)
relpath_5 = RelativePath(Path="tasks\PanelRationalize.gh")
panelrationalize = Hops(
    _Path=relpath_5,
    TaskID="f7399577-5d79-22ed-9b6a-0242ac990a02",
    SrfPanelsByScope=srf_panelsbyscope_4,
    CacheResultsInMemory=True,
    CacheSolveResults=True,
    RemoteDefinitionLocation="C:\Users\jkamm\git\DevHops\DevHopsGhSamples\tasks\PanelRationalize.gh",
    RemoteSolveVersion=(0, 1, 0),
    ShowInput_Enabled=False,
    ShowInput_Path=True,
    SynchronousSolve=True)

panel_6 = Panel("df63e25a-5d79-11ed-9b6a-0242ac120002")
brep_mass_3 = Data(massing)
srf_panelsbyscope_5 = Data(panelization)

# ----
# Preview Data by Colors
G = Data(srf_panelsbyscope_5)
evalsrf = EvaluateSurface(Surface=reparameterize(G), Point=Point(0.5, 0.5, 0))  # -> Point, Normal, UDirection, VDirection, Frame
tstat = TreeStatistics(Tree=simplify(G))  # -> Paths, Length, Count
crv = Curve(G)
randcol = RandomColor(Data=tstat.Paths, Seed=2, FastMode=False)
points = PointList(Points=evalsrf.Point)

preview = CustomPreview(Material=graft(ColourSwatch(SwatchColor=RGB(38, 141, 146))))  # disabled

# ---- group: Todo
panel_7 = Panel("f739958c-5d79-11ed-9b6a-0242ac120a02")
crv_mullionpipes = Data(substructure.CrvMullionPipes)
srf_panelsrationalized = Data(panelrationalize)

brep_mullionpipes = Data(substructure.BrepMullionPipes)
srf_panelsrationalized_2 = Data(panelrationalize)
panel_8 = Panel("ea4952b8-5d79-11ed-9b6a-024bac120002")

# ----
C = Colour([RGB(246, 220, 172), RGB(237, 176, 35), RGB(229, 115, 44), RGB(224, 59, 49), RGB(37, 159, 164), RGB(0, 139, 139)])
C_2 = Colour([RGB(246, 220, 172), RGB(237, 176, 35), RGB(229, 115, 44), RGB(224, 59, 49), RGB(37, 159, 164)])
long = LongestList(ListA=tstat.Paths, ListB=C_2, PaddingMode=4)  # -> ListA, ListB

preview_2 = CustomPreview(Geometry=G, Material=graft(long.ListB))
previewlw = CustomPreviewLineweights(Geometry=crv, Shader=ColourSwatch(SwatchColor=RGB(0, 0, 0)), Thickness=Slider(1, range=0..1), Absolute=False)

# ----
# Get Screenshots for Docs
iteratename = Button()
# Preview  Tools
bake_image = Button()
bake_text = Button()
open_image_text_folder = Button()
open_test_image_folder = Button()
pystep = PythonStepper(Up=iteratename)  # -> C
# ---------- pystep: Python ----------
initVal = 0
step = 1
reset = R
up = Up
down = Dn

if not 'acc' in vars():
    acc = initVal

if reset > 0:
    acc = initVal

if up > 0:
    acc += step
if down > 0:
    acc -= step

C = acc
# ---------- end pystep ----------
relpath_6 = RelativePath(Path="temp\screenshot")
format = Format(Format="{0}{1:00}{2}", Culture=127, Data0=relpath_6, Data1=pystep, Data2=".jpg")
panel_9 = Panel(format)
saveview = SaveViewportToFile(Run=bake_image, ViewportName="ScriptView", Render=False, FilePath=format, ScaleFactor=Slider(0.5, range=0..1))
img2str = SerializeImageToString(ImagePath=saveview)

len = TextLength(Text=saveview)
subtraction = Subtraction(A=len, B="3")
fragment = TextFragment(Text=saveview, Start="0", Count=subtraction)
concat = Concatenate(FragmentA=fragment, FragmentB="txt")

file = ReadFile(File=concat, PerLineParse=True)
writetxt = WriteToTextFile(Run=bake_text, TextToWrite=img2str, FilePath=concat, Append=False, NewOnly=False)
opensesame = SafeFolderOpener(Open=open_image_text_folder, Folders=concat)
str2img = DeserializeImageFromString(ImageString=file)
opensesame_2 = SafeFolderOpener(Open=open_test_image_folder, Folders=str2img)
