# Grasshopper definition AddNumbers.gh (Grasshopper 1.0.7)

a = GetInteger(AtLeast=1, AtMost=1, Maximum=2147483647, Minimum=-2147483648, TreeAccess=False)
b = GetInteger(AtLeast=1, AtMost=1, Maximum=2147483647, Minimum=-2147483648, TreeAccess=False)
addition = Addition(A=a, B=b)
context_print = ContextPrint(Text=addition)
