# Grasshopper definition Massing_1.1.gh (Grasshopper 1.0.7)

# ---- group: Hard-Coded Input
txt_message = Panel("Don't mess with me")  # disabled

geo_input = Curve([<curve referenced from the Rhino model> x18])  # disabled

# ---- group: User Input (Optional)
type_descriptivename = Slider(0.05, range=0..0.1)  # disabled

# ---- group: User Input (Must Use)
geo_input_2 = Curve([<curve referenced from the Rhino model> x18])  # disabled

# ---- group: User Action (Must Use)
button = Button()  # disabled

# ----
# Key
# Faint Wires between Groups
txt_message_2 = Data(txt_message)  # disabled
geo_input_3 = Curve(geo_input)  # disabled

# ----
# Description of
# Group Function
geo_input_4 = Curve(geo_input_3)  # disabled
txt_message_3 = Data(txt_message_2)  # disabled
# Goal: Note for future development of code.  Express as an action to complete
move = Move(Geometry=geo_input_4, Motion=Vector(0, 0, 10))  # -> Geometry, Transform; disabled

# ---- group: Data/Geo to Check
txt_message_4 = Panel(txt_message_3)  # disabled

# ---- group: To Output
geo_input_moved = Curve(move.Geometry)  # disabled

# ----
twistangle = Slider(180, range=0..180)

radius = GetInteger(Slider(60, range=0..100), AtLeast=1, AtMost=1, Maximum=2147483647, Minimum=-2147483648, TreeAccess=False)
twistangle_2 = GetInteger(twistangle, AtLeast=1, AtMost=1, Maximum=2147483647, Minimum=-2147483648, TreeAccess=False)
height = GetInteger(Slider(300, range=0..1000), AtLeast=1, AtMost=1, Maximum=2147483647, Minimum=-2147483648, TreeAccess=False)
taskid = GetString("task01", AtLeast=1, AtMost=1, TreeAccess=False)

# ----
# Massing
radius_2 = Data(radius)
height_2 = Data(height)
panel = Panel("Inputs")
taskid_2 = Data(taskid)

geo_inputmass = Geometry(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)
division = Division(A=radius_2, B2=2)
volume = Volume(Geometry=geo_inputmass)  # -> Volume, Centroid
neg = Negative(Value=division)
dom = ConstructDomain(DomainStart=neg, DomainEnd=division)
project = Project(Geometry=volume.Centroid, Plane=PlaneXY(0, 0, 0))  # -> Geometry, Transform
box = DomainBox(Base=project.Geometry, X=dom, Y=dom, Z=height_2)
brep_boxvol = Data(box)

num_radius = Data(radius_2)
devhops_component = Panel(taskid_2)

brep_boxvol_2 = Data(brep_boxvol)
volume_2 = Volume(Geometry=brep_boxvol_2)  # -> Volume, Centroid
Z = UnitZ(Factor=1)
debox = DeconstructBox(Box=brep_boxvol_2)  # -> Plane, X, Y, Z
line = LineSDL(Start=volume_2.Centroid, Direction=Z, Length=1)
num = Number(debox.Z)
multiplication = Multiplication(A=num, B=0.5)
ext = ExtendCurve(Curve=line, Type=0, Start=multiplication, End=multiplication)
crv_centeraxis = Data(ext)

num_radius_2 = Data(num_radius)
crv_centeraxis_2 = Data(crv_centeraxis)
polygon = Polygon(Plane=PlaneXY(0, 0, 0), Radius=num_radius_2, Segments=Slider(5, range=0..10), FilletRadius=0)  # -> Polygon, Length
len = Length(Curve=crv_centeraxis_2)
amp = Amplitude(Vector=crv_centeraxis_2, Amplitude=len)
extr = Extrude(Base=polygon.Polygon, Direction=amp)
brep_profile_extruded = Data(extr)

int_twistangle_degrees = Data(twistangle_2)
brep_profile_extruded_2 = Data(brep_profile_extruded)
crv_centeraxis_3 = Data(crv_centeraxis)
rad = Radians(Degrees=int_twistangle_degrees)
cap = CapHoles(Brep=brep_profile_extruded_2)
twist = Twist(Geometry=cap, Axis=crv_centeraxis_3, Angle=rad, Infinite=False, Rigid=False)
brep_profile_twisted = Data(twist)

brep_profile_twisted_2 = Data(brep_profile_twisted)
crv_centeraxis_4 = Data(crv_centeraxis)
taper = Taper(
    Geometry=brep_profile_twisted_2,
    Axis=crv_centeraxis_4,
    Start=Slider(100, range=0..100),
    End=Slider(40, range=0..100),
    Flat=False,
    Infinite=False,
    Rigid=False)
brep_massoutput = Data(taper)

context_bake = ContextBake(BrepMassOutput=brep_massoutput)
