# Grasshopper definition Panelization.gh (Grasshopper 1.0.7)
# plug-ins: LunchBox, eleFront

# ---- group: Hard-Coded Input
txt_message = Panel("Don't mess with me")  # disabled

geo_input = Curve([<curve referenced from the Rhino model> x18])  # disabled

# ---- group: User Input (Optional)
type_descriptivename = Slider(0.05, range=0..0.1)  # disabled

# ---- group: User Input (Must Use)
geo_input_2 = Curve([<curve referenced from the Rhino model> x18])  # disabled

# ---- group: User Action (Must Use)
# Code Information: Author:
# Contact:
# 
# Date:
# Project:
button = Button()  # disabled

# ----
# Key
# Faint Wires between Groups
txt_message_2 = Data(txt_message)  # disabled
geo_input_3 = Curve(geo_input)  # disabled

# ----
# Description of
# Group Function
geo_input_4 = Curve(geo_input_3)  # disabled
txt_message_3 = Data(txt_message_2)  # disabled
# Goal: Note for future development of code.  Express as an action to complete
move = Move(Geometry=geo_input_4, Motion=Vector(0, 0, 10))  # -> Geometry, Transform; disabled

# ---- group: Data/Geo to Check
txt_message_4 = Panel(txt_message_3)  # disabled

# ---- group: To Output
# Code Description: Panelization function
# inputs:
# -
# outputs:
# -
geo_input_moved = Curve(move.Geometry)  # disabled

# ----
brep_mass_proxy = Geometry(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)

taskid = GetString("ADD TASK ID", AtLeast=0, AtMost=1, Prompt="Unique Task ID", TreeAccess=False)
brep_mass = GetGeometry(brep_mass_proxy, AtLeast=1, AtMost=1, DeleteInput=False, Filter=1074004029, TreeAccess=False)
int_facecount_u_persrf = GetInteger(Slider(4, range=0..10), AtLeast=1, AtMost=1, Maximum=100, Minimum=1, TreeAccess=False)

taskid_2 = Data(taskid)
devhops_component = Panel(taskid_2)

# ----
# Panelization
ufacesubdivisions = Data(int_facecount_u_persrf)

# ----
# Get Surfaces from Mass
brep_mass_2 = Data(brep_mass)
debrep = DeconstructBrep(Brep=brep_mass_2)  # -> Faces, Edges, Vertices
evalsrf = EvaluateSurface(Surface=debrep.Faces, Point=Point(0.5, 0.5, 0))  # -> Point, Normal, UDirection, VDirection, Frame
pdecon = Deconstruct(Point=evalsrf.Point)  # -> XComponent, YComponent, ZComponent
sort = SortList(Keys=pdecon.ZComponent, ValuesA=debrep.Faces)  # -> Keys, ValuesA
panel = Panel("""0
-1""")
cull_i = CullIndex(List=sort.ValuesA, Indices=panel, Wrap=True)
srf_srfstopanel = Data(cull_i)

# ----
# Goal: Make Panels roughly Square (by evaluation, not graph Mapper)
srf_srfstopanel_2 = Data(srf_srfstopanel)
item = ListItem(List=srf_srfstopanel_2, Index=0, Wrap=True)
dim = Dimensions(Surface=item)  # -> UDimension, VDimension
division = Division(A=dim.UDimension, B=dim.VDimension)
multiplication = Multiplication(A=ufacesubdivisions, B=division)
range = Range(Domain=Domain(0, 1), Steps=multiplication)
graph = GraphMapper(
    range,
    x0=0,
    x1=1,
    y0=0,
    y1=1,
    container_name="Bezier",
    cpx=[0, 0.2271746248, 0.5341230631, 1],
    cpy=[0, 0.3161061406, 0.721015811, 1])
range_2 = Range(Domain=Domain(0, 1), Steps=ufacesubdivisions)
consec = ConsecutiveDomains(Numbers=graph, Additive=False)
consec_2 = ConsecutiveDomains(Numbers=range_2, Additive=False)
dom² = ConstructDomain²(DomainU=consec, DomainV=graft(consec_2))
graftp = GraftParallel(PrimaryData=srf_srfstopanel_2, SecondaryData1=flatten(dom²))  # -> PrimaryData, SecondaryData1
subsrf = Isotrim(Surface=reparameterize(graft(graftp.PrimaryData)), Domain=graftp.SecondaryData1)
lng = ListLength(List=subsrf)
division_2 = Division(A=lng, B=ufacesubdivisions)
partition = PartitionList(List=subsrf, Size=division_2)
pshift = ShiftPaths(Data=simplify(partition), Offset=-1)
srf_panelsbyscope = Data(pshift)
context_bake = ContextBake(SrfPanelsByScope=srf_panelsbyscope)

# ----
# Alternative Paneling
number_slider = Slider(41, range=0..100)  # disabled
number_slider_2 = Slider(6, range=0..100)  # disabled
srf = Data(srf_srfstopanel)  # disabled
diamond = DiamondPanels(Surface=srf, UDivisions=number_slider, VDivisions=number_slider_2)  # -> DiamondPanels, TriPanels; disabled
quads = QuadPanels(Surface=srf, UDivisions=number_slider, VDivisions=number_slider_2)  # disabled
srf_panelsbyscope_2 = Data(diamond.DiamondPanels)  # disabled
srf_panelsbyscope_3 = Data(diamond.TriPanels)  # disabled
