# Grasshopper definition Panelization_2.0.gh (Grasshopper 1.0.7)
# plug-ins: DevHopsGH, eleFront Rhino 6 Legacy

# ---- group: Hard-Coded Input
txt_message = Panel("Don't mess with me")  # disabled

geo_input = Curve([<curve referenced from the Rhino model> x18])  # disabled

# ---- group: User Input (Optional)
type_descriptivename = Slider(0.05, range=0..0.1)  # disabled

# ---- group: User Input (Must Use)
geo_input_2 = Curve([<curve referenced from the Rhino model> x18])  # disabled

# ---- group: User Action (Must Use)
# Code Information: Author:
# Contact:
# 
# Date:
# Project:
button = Button()  # disabled

# ----
# Key
# Faint Wires between Groups
txt_message_2 = Data(txt_message)  # disabled
geo_input_3 = Curve(geo_input)  # disabled

# ----
# Description of
# Group Function
geo_input_4 = Curve(geo_input_3)  # disabled
txt_message_3 = Data(txt_message_2)  # disabled
# Goal: Note for future development of code.  Express as an action to complete
move = Move(Geometry=geo_input_4, Motion=Vector(0, 0, 10))  # -> Geometry, Transform; disabled

# ---- group: Data/Geo to Check
txt_message_4 = Panel(txt_message_3)  # disabled

# ---- group: To Output
geo_input_moved = Curve(move.Geometry)  # disabled

# ----
# Code Description: Panelization function
# inputs:
# -
# outputs:
# -
panel = Panel("df63e25a-5d79-11ed-9b6a-0242ac120002")
brep_mass_proxy = Geometry(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)

brep_mass = GetGeometry(brep_mass_proxy, AtLeast=1, AtMost=1, DeleteInput=False, Filter=1074004029, TreeAccess=False)
int_facecount_u_persrf = GetInteger(Slider(4, range=0..10), AtLeast=1, AtMost=1, Maximum=100, Minimum=1, TreeAccess=False)
taskid = GetString(panel, AtLeast=0, AtMost=1, Prompt="Unique Task ID", TreeAccess=False)

# ----
# Panelization
taskid_2 = Data(taskid)
devhopsgh = DevHopsGH(TaskID=taskid_2)  # -> TaskStatus, Comments

# ----
# Get Surfaces from Mass
brep_mass_2 = Data(brep_mass)
debrep = DeconstructBrep(Brep=brep_mass_2)  # -> Faces, Edges, Vertices
evalsrf = EvaluateSurface(Surface=debrep.Faces, Point=Point(0.5, 0.5, 0))  # -> Point, Normal, UDirection, VDirection, Frame
pdecon = Deconstruct(Point=evalsrf.Point)  # -> XComponent, YComponent, ZComponent
sort = SortList(Keys=pdecon.ZComponent, ValuesA=debrep.Faces)  # -> Keys, ValuesA
panel_2 = Panel("""0
-1""")
cull_i = CullIndex(List=sort.ValuesA, Indices=panel_2, Wrap=True)
srf_srfstopanel = Data(cull_i)

panel_3 = Panel(devhopsgh.Comments)
panel_4 = Panel(devhopsgh.TaskStatus)

# ----
# Adjust UV intervals to get Squarish panels
# (WIP)
# Goal: Make Panels roughly Square (by evaluation, not graph Mapper)
srf_srfstopanel_2 = Data(srf_srfstopanel)
ufacesubdivisions = Data(int_facecount_u_persrf)
item = ListItem(List=srf_srfstopanel_2, Index=0, Wrap=True)
dim = Dimensions(Surface=item)  # -> UDimension, VDimension
division = Division(A=dim.UDimension, B=dim.VDimension)
multiplication = Multiplication(A=ufacesubdivisions, B=division)
range = Range(Domain=Domain(0, 1), Steps=multiplication)
range_2 = Range(Domain=Domain(0, 1), Steps=ufacesubdivisions)
graph = GraphMapper(
    range,
    x0=0,
    x1=1,
    y0=0,
    y1=1,
    container_name="Bezier",
    cpx=[0, 0.2271746248, 0.5634783506, 1],
    cpy=[0, 0.3161061406, 0.7315399647, 1])
consec = ConsecutiveDomains(Numbers=range_2, Additive=False)
consec_2 = ConsecutiveDomains(Numbers=graph, Additive=False)
dom² = ConstructDomain²(DomainU=consec_2, DomainV=graft(consec))
graft = GraftParallelR6(PrimaryData=srf_srfstopanel_2, SecondaryData1=flatten(dom²))  # -> PrimaryData, SecondaryData1
subsrf = Isotrim(Surface=reparameterize(graft(graft.PrimaryData)), Domain=graft.SecondaryData1)

updatestatuscomponent = UpdateStatusComponent(TaskID=taskid_2, Status="Review", Screenshot=Toggle(False), AddComment="comments addressed")  # disabled

# ----
# Modify Data Structure to match
# Scope/Column/Sequence
ufacesubdivisions_2 = Data(ufacesubdivisions)
S = Data(subsrf)

lng = ListLength(List=S)
division_2 = Division(A=lng, B=ufacesubdivisions_2)
partition = PartitionList(List=S, Size=division_2)

srf_panelsbyscope = Data(simplify(partition))

srf_panelsbyscope_2 = Data(simplify(srf_panelsbyscope))
context_bake = ContextBake(SrfPanelsByScope=srf_panelsbyscope_2)
