# Grasshopper definition Patterning.gh (Grasshopper 1.0.7)

# ---- group: Hard-Coded Input
txt_message = Panel("Don't mess with me")  # disabled

geo_input = Curve([<curve referenced from the Rhino model> x18])  # disabled

# ---- group: User Input (Optional)
type_descriptivename = Slider(0.05, range=0..0.1)  # disabled

# ---- group: User Input (Must Use)
geo_input_2 = Curve([<curve referenced from the Rhino model> x18])  # disabled

# ---- group: User Action (Must Use)
button = Button()  # disabled

# ----
# Key
# Faint Wires between Groups
txt_message_2 = Data(txt_message)  # disabled
geo_input_3 = Curve(geo_input)  # disabled

# ----
# Description of
# Group Function
geo_input_4 = Curve(geo_input_3)  # disabled
txt_message_3 = Data(txt_message_2)  # disabled
# Goal: Note for future development of code.  Express as an action to complete
move = Move(Geometry=geo_input_4, Motion=Vector(0, 0, 10))  # -> Geometry, Transform; disabled

# ---- group: Data/Geo to Check
txt_message_4 = Panel(txt_message_3)  # disabled

# ---- group: To Output
geo_input_moved = Curve(move.Geometry)  # disabled

# ----
srf_panelsbyscope = Data(Tree({0}: [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], {1}: [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], {2}: [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], {3}: [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], {4}: [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], {5}: [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]))

taskid = GetString("Add ID", AtLeast=1, AtMost=1, TreeAccess=False)
taskid_2 = Data(taskid)
devhops_component = Panel(taskid_2)

null = Data()

# ----
# Develop Surface Patterning
srf_panelsbyscope_2 = GetGeometry(srf_panelsbyscope, AtLeast=1, AtMost=1, DeleteInput=False, Filter=1074004029, TreeAccess=False)
panel = Panel("Develop Panel Geometry")
srf_panelsbyscope_3 = Data(srf_panelsbyscope_2)
srf_panelpattern = ContextBake(SrfPanelPattern=null)
