# Grasshopper definition SubStructures.gh (Grasshopper 1.0.7)
# plug-ins: Sasquatch

# ---- group: Hard-Coded Input
txt_message = Panel("Don't mess with me")  # disabled

geo_input = Curve([<curve referenced from the Rhino model> x18])  # disabled

# ---- group: User Input (Optional)
type_descriptivename = Slider(0.05, range=0..0.1)  # disabled

# ---- group: User Input (Must Use)
geo_input_2 = Curve([<curve referenced from the Rhino model> x18])  # disabled

# ---- group: User Action (Must Use)
# Code Information: Author:
# Contact:
# 
# Date: 11/5/22
# Project: devHops
button = Button()  # disabled

# ----
# Key
# Faint Wires between Groups
txt_message_2 = Data(txt_message)  # disabled
geo_input_3 = Curve(geo_input)  # disabled

# ----
# Description of
# Group Function
geo_input_4 = Curve(geo_input_3)  # disabled
txt_message_3 = Data(txt_message_2)  # disabled
# Goal: Note for future development of code.  Express as an action to complete
move = Move(Geometry=geo_input_4, Motion=Vector(0, 0, 10))  # -> Geometry, Transform; disabled

# ---- group: Data/Geo to Check
txt_message_4 = Panel(txt_message_3)  # disabled

# ---- group: To Output
geo_input_moved = Curve(move.Geometry)  # disabled

# ----
num_piperadius = Slider(0.4, range=0..1)
# Code Description: Develop Substructure
# Goals:
# - Mullion lines
# - Panel Tabs?
panel = Panel("ADD TASK ID")

srf_panelsbyscope = Data(Tree({0}: [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], {1}: [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], {2}: [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], {3}: [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], {4}: [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], {5}: [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]))  # disabled
srf_panelsbyscope_2 = Geometry(Tree({0;0;0;0;0;0}: [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], {0;0;0;0;0;1}: [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], {0;0;0;0;0;2}: [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], {0;0;0;0;0;3}: [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], {0;0;0;1;0;0}: [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], {0;0;0;1;0;1}: [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]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))

geo_inputmass = Geometry(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)
taskid = GetString(panel, AtLeast=0, AtMost=1, Prompt="Unique Task ID", TreeAccess=False)

# ----
# Adjust pipe members to taper by location
srf_panelsbyscope_3 = GetGeometry(srf_panelsbyscope_2, AtLeast=1, AtMost=1, DeleteInput=False, Filter=3220963274, TreeAccess=True)
Z = UnitZ(Factor=1)
srf_panelsbyscope_4 = Data(srf_panelsbyscope_3)
edgesdir = EdgesFromDirections(Brep=srf_panelsbyscope_4, Directions=Z, Reflex=True, Angle=Slider(0.825, range=0..10))  # -> Edges, Indices, Map
pshift = ShiftPaths(Data=edgesdir.Edges, Offset=-1)
midpt = CurveMiddle(Curve=pshift)
cullpt = CullDuplicates(Points=midpt, Tolerance=0.1, CullMode=1)  # -> Points, Indices, Valence
item = ListItem(List=pshift, Index=cullpt.Indices, Wrap=True)
join = JoinCurves(Curves=item, Preserve=False)
crv_paneledges_vertical = Data(join)

taskid_2 = Data(taskid)
devhops_component = Panel(taskid_2)

# ----
# horizontal panel edges
# Can be used for sizing variable pipes
debrep = DeconstructBrep(Brep=srf_panelsbyscope_4)  # -> Faces, Edges, Vertices; disabled
cull_i = CullIndex(List=debrep.Edges, Indices=edgesdir.Indices, Wrap=True)  # disabled
join_2 = JoinCurves(Curves=cull_i, Preserve=False)  # disabled
crv_horizontal_edges = Data(join_2)  # disabled

# ----
# Develop Substructure
# Make this less garbagey
brep_mass = GetGeometry(geo_inputmass, AtLeast=1, AtMost=1, DeleteInput=False, Filter=3220963282, TreeAccess=False)
num_piperadius_2 = GetNumber(num_piperadius, AtLeast=0, AtMost=1, Maximum=1.797693135e+308, Minimum=-1.797693135e+308, TreeAccess=False)

# ----
# Remove Top And Bottom Surface
brep_inputmass = Geometry(brep_mass)
debrep_2 = DeconstructBrep(Brep=brep_inputmass)  # -> Faces, Edges, Vertices
evalsrf = EvaluateSurface(Surface=reparameterize(debrep_2.Faces), Point=Point(0.5, 0.5, 0))  # -> Point, Normal, UDirection, VDirection, Frame
pdecon = Deconstruct(Point=evalsrf.Point)  # -> XComponent, YComponent, ZComponent
sort = SortList(Keys=pdecon.ZComponent, ValuesA=debrep_2.Faces)  # -> Keys, ValuesA
panel_2 = Panel("""0
-1""")
cull_i_2 = CullIndex(List=sort.ValuesA, Indices=panel_2, Wrap=True)
join_3 = BrepJoin(Breps=cull_i_2)  # -> Breps, Closed
brep_input_open = Data(join_3.Breps)

brep_input_open_2 = Data(brep_input_open)
neg = Negative(Value=Slider(1.3, range=0..10))
offsetbrep = OffsetBrep(Brep=brep_input_open_2, OffsetDistance=neg, Solid=False, SharpEdges=True, Tolerance=0.001)
debrep_3 = DeconstructBrep(Brep=offsetbrep)  # -> Faces, Edges, Vertices
srf_srfstopanel = Data(debrep_3.Faces)
G = Data(offsetbrep)

# ----
# cull last of each side?
C = Data(crv_paneledges_vertical)
L = Data(srf_srfstopanel)
midpt_2 = CurveMiddle(Curve=C)
Z_2 = UnitZ(Factor=1)
line = LineSDL(Start=midpt_2, Direction=Z_2, Length=1)
panel_3 = Panel("Sort Pipes")
crvnear = CurveNearestObject(Curve=line, Geometry=L)  # -> PointA, PointB, Index
item_2 = ListItem(List=L, Index=crvnear.Index, Wrap=True)
pull = PullCurve(Curve=C, Surface=item_2)
C_2 = Data(pull)

G_2 = Data(G)
srf_panelsbyscope_5 = Data(G_2)
Z_3 = UnitZ(Factor=1)
debrep_4 = DeconstructBrep(Brep=srf_panelsbyscope_5)  # -> Faces, Edges, Vertices
edgesdir_2 = EdgesFromDirections(Brep=srf_panelsbyscope_5, Directions=Z_3, Reflex=True, Angle=Slider(0.825, range=0..10))  # -> Edges, Indices, Map
item_3 = ListItem(List=debrep_4.Edges, Index=edgesdir_2.Indices, Wrap=True)

merge = Merge(Data1=simplify(C_2), Data2=simplify(item_3))
num_piperadius_3 = Data(num_piperadius_2)
pipe = Pipe(Curve=merge, Radius=num_piperadius_3, Caps=0)
crv_mullionpipes = Data(merge)
brep_mullionpipes = Data(pipe)

panel_4 = Panel(C_2)
context_bake = ContextBake(BrepMullionPipes=brep_mullionpipes)
context_bake_2 = ContextBake(CrvMullionPipes=crv_mullionpipes)
